# Grasshopper definition excelTest.gh (Grasshopper 1.0.7)
# plug-ins: BH.UI.Grasshopper

createtype = CreateType(Component="System.Object")
panel = Panel("""font-family
rowheight
columnwidth""")
panel_2 = Panel("""Arial
20
20""")
panel_3 = Panel("""font-family
rowheight
columnwidth""")
panel_4 = Panel("""Arial,monospace
20
20""")
createtype_2 = CreateType(Component="System.String")
createtype_3 = CreateType(Component="System.String")
createdictionary = CreateDictionary(Keys=panel, Values=panel_2, KeyType=createtype_2, ValueType=createtype, Component="{ .CreateDictionary")
createdictionary_2 = CreateDictionary(Keys=panel_3, Values=panel_4, KeyType=createtype_3, ValueType=createtype, Component="{ .CreateDictionary")
ruleset = RuleSet(Selector="worksheet", Declarations=createdictionary_2, Component="BH.oM.Excel.RuleSet")
ruleset_2 = RuleSet(Selector="workbook", Declarations=createdictionary, Component="BH.oM.Excel.RuleSet")
explode = Explode(Object=ruleset_2, Component="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")  # -> Selector, Declarations, BHoM_Guid, Name, Fragments, Tags, CustomData

excelsettings = ExcelSettings(
    Worksheets="FinalScore",
    NewFile=True,
    Style="{ \"_t\" : \"BH.oM.Excel.Style\", \"BHoM_Guid\" : \"1df2764b-f991-4a41-9065-25947d1cf493\", \"Name\" : \"\", \"Fragments\" : [], \"Tags\" : [], \"CustomData\" : { }, \"RuleSets\" : [] }",
    Component="BH.oM.Excel.Settings.ExcelSettings")
filesettings = FileSettings(
    FileName="VPRMatrix200417.xlsx",
    Directory="C:\Users\Admin\Documents\projects\BHoM\dev\Excel",
    Component="BH.oM.Adapter.FileSettings")
exceladapter = ExcelAdapter(FileSettings=filesettings, ExcelSettings=excelsettings, Component="{ ..ctor")
valuesrequest = ValuesRequest(Component="BH.oM.Excel.ValuesRequest")
cellsrequest = CellsRequest(Component="BH.oM.Excel.CellsRequest")
pull = Pull(
    Adapter=exceladapter,
    Request=cellsrequest,
    PullType="{ \"_t\" : \"System.Enum\", \"TypeName\" : { \"_t\" : \"System.Type\", \"Name\" : \"BH.oM.Adapter.PullType\" }, \"Value\" : \"AdapterDefault\" }",
    Active=Toggle(False),
    Component="{ .Pull")
values = Values(Table=pull, Component="{ .Values")
explode_2 = Explode(Object=values, Component="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")  # -> A, B, C, D, Name, Tags, BHoM_Guid
explode_3 = Explode(Object=explode_2.A, Component="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")  # -> Comment, Value, Address, DataType, FormulaA1, FormulaR1C1, HyperLink, RichText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
panel_5 = Panel(explode_2.B)
panel_6 = Panel(explode_3.RichText)
panel_7 = Panel(explode_2.C)
panel_8 = Panel(explode_2.D)
panel_9 = Panel(explode_2.Name)
panel_10 = Panel(explode_2.Tags)

panel_11 = Panel("""padding-top
padding-bottom
text-align
background-color
color""")
panel_12 = Panel("""12px
12px
left
#4CAF50
white""")
panel_13 = Panel("""font-family
border-collapse""")
panel_14 = Panel("""Arial, Helvetica, sans-serif
collapse""")
panel_15 = Panel("""1px solid #ddd
8px""")
panel_16 = Panel("""border
padding""")
createtype_4 = CreateType(Component="System.String")
createtype_5 = CreateType(Component="System.String")
createtype_6 = CreateType(Component="System.String")
createtype_7 = CreateType(Component="System.String")
createdictionary_3 = CreateDictionary(Keys=panel_13, Values=panel_14, KeyType=createtype_4, ValueType=createtype, Component="{ .CreateDictionary")
createdictionary_4 = CreateDictionary(Keys=panel_11, Values=panel_12, KeyType=createtype_5, ValueType=createtype, Component="{ .CreateDictionary")
createdictionary_5 = CreateDictionary(Keys=panel_16, Values=panel_15, KeyType=createtype_6, ValueType=createtype, Component="{ .CreateDictionary")
createdictionary_6 = CreateDictionary(Keys="background-color", Values="#f2f2f2", KeyType=createtype_7, ValueType=createtype, Component="{ .CreateDictionary")

ruleset_3 = RuleSet(Selector="th", Declarations=createdictionary_4, Component="BH.oM.Excel.RuleSet")
ruleset_4 = RuleSet(Selector="tr:nth-child(even)", Declarations=createdictionary_6, Component="BH.oM.Excel.RuleSet")
ruleset_5 = RuleSet(Selector="table", Declarations=createdictionary_3, Component="BH.oM.Excel.RuleSet")
ruleset_6 = RuleSet(Selector="td, th", Declarations=createdictionary_5, Component="BH.oM.Excel.RuleSet")
data = Data([ruleset, ruleset_2, ruleset_5, ruleset_3, ruleset_6, ruleset_4])

style = Style(RuleSets=data, Component="BH.oM.Excel.Style")

number_slider = Slider(10, range=0..10)
excelsettings_2 = ExcelSettings(NewFile=Toggle(False), Style=style, Component="BH.oM.Excel.Settings.ExcelSettings")
filesettings_2 = FileSettings(
    FileName="PushTest.xlsx",
    Directory="C:\Users\Admin\Documents\projects\BHoM\dev\Excel",
    Component="BH.oM.Adapter.FileSettings")
repeat = RepeatData(Data=number_slider, Length=number_slider)
exceladapter_2 = ExcelAdapter(FileSettings=filesettings_2, ExcelSettings=excelsettings_2, Component="{ ..ctor")
panel_17 = Panel("""lend
need
seem
enjoy
reveal
rise
translate
incorporate
score
charge""")
panel_18 = Panel("""useful
small
illegal
past
defiant
solid
numerous
understood
greasy
pleasant""")
random = Random(Range=Domain(0, 1), Number=graft(repeat), Seed=Slider(0, range=0..10))  # -> simplify(Random)
table = Table(
    Name="testTable",
    Axis1Name="verb",
    Axis1Values=panel_17,
    Axis2Name="adjective",
    Axis2Values=panel_18,
    Values=random,
    ValuesName="Values",
    Component="{ .Table")
push = Push(
    Adapter=exceladapter_2,
    Objects=flatten(table),
    PushType="{ \"_t\" : \"System.Enum\", \"TypeName\" : { \"_t\" : \"System.Type\", \"Name\" : \"BH.oM.Adapter.PushType\" }, \"Value\" : \"AdapterDefault\" }",
    Active=Toggle(False),
    Component="{ .Push")  # -> Objects, Success
